# Grasshopper definition front_end.gh (Grasshopper 1.0.7)
# plug-ins: MeshEdit Components

radpargridbased = HoneybeePlus_RadianceParametersGridBased(complexity=Slider(0, range=0..2), recipe_type="1")  # -> report, rad_par, vmtx_par, dmtx_par, smtx_par; plug-in component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
d_matrix = Panel(radpargridbased.dmtx_par)

radpargridbased_2 = HoneybeePlus_RadianceParametersGridBased(complexity=Slider(0, range=0..2), recipe_type="1")  # -> report, rad_par, vmtx_par, dmtx_par, smtx_par; plug-in component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
v_matrix = Panel(radpargridbased_2.vmtx_par)
d_matrix_2 = Panel(radpargridbased_2.dmtx_par)

radopaquemat = HoneybeePlus_RadianceOpaqueMaterial(name="Context_mat", reflect="0.2", spec=0, rough=0)  # -> material; plug-in component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
context = Brep([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])
hbsurface = HoneybeePlus_HoneybeeSurface(geo=context, names="Context", rad_mat=radopaquemat)  # -> report, HB_srf; plug-in component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

panel_2 = Panel("C:\baseline_test_new\input")

# ---- group: Ext. walls only
brep = Brep([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])

# ----
area = Area(Geometry=brep)  # -> Area, Centroid
genpts = LBGeneratePointGrid(geometry=brep, grid_size="4", offset_dist="0.05")  # -> points, vectors, face_areas, graft(mesh); plug-in component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
panel_3 = Panel(area.Area)
facen = FaceNormals(Mesh=genpts.mesh)  # -> Centers, Normals
analysisgrid = HoneybeePlus_AnalysisGrid(name="facade_points_88", test_points=genpts.points, pts_vectors=genpts.vectors)  # -> analysis_grid; plug-in component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
vdis = VectorDisplay(Anchor=facen.Centers, Vector=facen.Normals)

# ---- group: Rest of Volume massing
zone = Brep([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])

# ----
hbsurface_2 = HoneybeePlus_HoneybeeSurface(geo=zone)  # -> report, HB_srf; plug-in component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
hbsurface_3 = HoneybeePlus_HoneybeeSurface(geo=brep)  # -> report, HB_srf; plug-in component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

wires = BrepWireframe(Brep=[zone, brep], Density=-1)
# VMT tool input
preview = CustomPreview(Geometry=[zone, brep], Material=ColourSwatch(SwatchColor=RGB(255, 0, 0)))

wires_2 = BrepWireframe(Brep=context, Density=-1)
preview_2 = CustomPreview(Geometry=context, Material=ColourSwatch(SwatchColor=RGB(150, 150, 150)))

panel_4 = Panel("C:\Users\Pedersen_Admin\OneDrive - Perkins and Will\Documents\GitHub\VMT\database\smx\IWEC\Norway\Oslo\NOR_Oslo.Fornebu.014880_IWEC.epw")
wea = HoneybeePlus_WEAFromEPW(epw_file=panel_4)  # -> wea; plug-in component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
skymatrix = HoneybeePlus_SkyMatrix(name="SkyMatrix_88", north=0, wea=wea, density=1)  # -> skymtx; plug-in component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

mesh = Mesh(genpts.mesh)
explode = MeshExplode(Mesh=mesh, Interpolate=False)
# Honeybee Simulation
panel_5 = Panel(explode)

# ---- group: Export rest of volume massing to rad
panel_6 = Panel("volume_massing_rest.rad")
hbtorad = HoneybeePlus_WriteHBObjectsToRadiance(HB_objects=hbsurface_2.HB_srf, folder=panel_2, file_name=panel_6, write=Toggle(False))  # -> rad_file; plug-in component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
concat = Concatenate(FragmentA=panel_2, FragmentB="\", FragmentC=panel_6)
importrad = Honeybee_ImportRad(radianceFile=concat)  # -> RADMaterials, RADSurfaces; disabled; plug-in component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

# ---- group: Export volume massing to rad
hbtorad_2 = HoneybeePlus_WriteHBObjectsToRadiance(HB_objects=hbsurface_3.HB_srf, folder=panel_2, file_name="volume_massing.rad", write=Toggle(False))  # -> rad_file; plug-in component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
concat_2 = Concatenate(FragmentA=panel_2, FragmentB="\", FragmentC="volume_massing.rad")
importrad_2 = Honeybee_ImportRad(radianceFile=concat_2)  # -> RADMaterials, RADSurfaces; disabled; plug-in component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

# ---- group: Export context to rad
hbtorad_3 = HoneybeePlus_WriteHBObjectsToRadiance(HB_objects=hbsurface.HB_srf, folder=panel_2, file_name="context.rad", write=Toggle(False))  # -> rad_file; plug-in component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
concat_3 = Concatenate(FragmentA=panel_2, FragmentB="\", FragmentC="context.rad")
importrad_3 = Honeybee_ImportRad(radianceFile=concat_3)  # -> RADMaterials, RADSurfaces; disabled; plug-in component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

# ----
flatten = FlattenTree(Tree=analysisgrid, Path="{0}")

annualradrecipe = HoneybeePlus_AnnualRadiationRecipe(skymtx=skymatrix, analysis_grids=flatten, dmtx_par=radpargridbased_2.dmtx_par, reuse_dmtx="True")  # -> analysis_recipe; plug-in component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

panel_7 = Panel("C:\Users\Pedersen_Admin\OneDrive - Perkins and Will\Desktop\baseline_test")
data = Data([hbsurface_2.HB_srf, hbsurface.HB_srf])
runradiance = HoneybeePlus_RunRadianceAnalysis(
    analysis_recipe=annualradrecipe,
    HB_objects=data,
    folder=panel_7,
    name="HBplus_RADIATION",
    write=Toggle(False),
    run=Toggle(False))  # -> report, legend_par, outputs; plug-in component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

panel_8 = Panel("C:\baseline_test\radiation_analysis\output\radiation_result_cummulative.txt")

concat_4 = Concatenate(FragmentA="C:\baseline_test\radiation_analysis\surf", FragmentB="\surf_all.pts")
python = GhPythonScript(all_points_file=concat_4, run=Toggle(True))  # -> out, P, N
# ---------- python: Python ----------
__author__ = "Pedersen_Admin"
__version__ = "2021.02.10"

import rhinoscriptsyntax as rs
import os 

if run:
    P = []
    N = []
    with open(all_points_file, "r") as infile:
        content = infile.readlines()
        
    for i in range(len(content)):
        try:
            numbers = content[i].split(" ")
            print(numbers)
            P.append(rs.AddPoint(float(numbers[0]),float(numbers[1]),float(numbers[2])))
            
            N.append(rs.AddPoint(float(numbers[3]),float(numbers[4]),float(numbers[5])))
            
        except: #Last line
            pass
# ---------- end python ----------
vdis_2 = VectorDisplay(Anchor=python.P, Vector=python.N)

panel_9 = Panel(genpts.mesh)
cumvalue = HoneybeePlus_CumulativeValue(analysis_grid=runradiance.outputs)  # -> report, values; plug-in component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
panel_10 = Panel(cumvalue.values)
flatten_2 = FlattenTree(Tree=cumvalue.values, Path="{0}")
sort = SortList(Keys=flatten_2)  # -> Keys, ValuesA
item = ListItem(List=sort.Keys, Index="-1", Wrap=True)
item_2 = ListItem(List=sort.Keys, Index="0", Wrap=True)
panel_11 = Panel(sort.Keys)
panel_12 = Panel(item_2)
panel_13 = Panel(item)
legendpar = LBLegendParameters(min=item_2, max=item)  # -> leg_par; plug-in component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
heatmap = LBSpatialHeatmap(values=cumvalue.values, mesh=genpts.mesh, legend_par=legendpar)  # -> mesh, legend, title, colors, legend_par; plug-in component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

panel_14 = Panel("""\mesh_0.txt
\mesh_1.txt
\mesh_2.txt
\mesh_3.txt""")

concat_5 = Concatenate(FragmentA="C:\baseline_test\radiation_analysis\mesh", FragmentB=panel_14)
panel_15 = Panel(concat_5)

python_2 = GhPythonScript(mesh_files=concat_5, run=Toggle(True))  # -> out, M, Sequence
# ---------- python_2: Python ----------
__author__ = "Pedersen_Admin"
__version__ = "2021.02.10"

import rhinoscriptsyntax as rs
import os 

if run:
    V = []
    F = []
    with open(mesh_files, "r") as infile:
        content = infile.readlines()
    
    read_vertices = False
    read_fases = False
    for j in range(len(content)):
        
        if "### Mesh vertices" in content[j]:
            read_vertices = True
            read_fases = False
            continue
            
        elif "### Mesh faces" in content[j]:
            read_vertices = False
            read_fases = True
            continue
        
        if read_vertices:
            numbers = content[j].split(" ")
            V.append((float(numbers[0]),
            float(numbers[1]),
            float(numbers[2])))
            
        elif read_fases:
            numbers = content[j].split(" ")
            F.append((int(numbers[0]),
            int(numbers[1]),
            int(numbers[2]),
            int(numbers[3])))
    
    M = rs.AddMesh(V,F) #https://discourse.mcneel.com/t/creating-meshes-from-scratch/22504/2
# ---------- end python_2 ----------
mesh_2 = Mesh(python_2.M)

explode_2 = MeshExplode(Mesh=mesh_2, Interpolate=False)
lng = ListLength(List=explode_2)
panel_16 = Panel(lng)
flatten_3 = FlattenTree(Tree=panel_16, Path="{0}")
panel_17 = Panel(flatten_3)
python_3 = GhPythonScript(cummulative_results_file=panel_8, sequence=panel_17)  # -> output; inputs sequence: list
# ---------- python_3: Python ----------
__author__ = "Pedersen_Admin"
__version__ = "2021.02.15"

import rhinoscriptsyntax as rs

with open(cummulative_results_file, "r") as infile:
    content = infile.readlines()

output = []
j = 0
k = int(sequence[j])
output_tmp = []
for i in range(1,len(content)):
    output_tmp.append(float(content[i]))
    
    if i == k:
        j = j + 1
        if j != len(sequence):
            k = k + int(sequence[j])
            output.append(output_tmp)
            output_tmp = []
# ---------- end python_3 ----------
panel_18 = Panel(python_3)
panel_19 = Panel(mesh_2)
heatmap_2 = LBSpatialHeatmap(values=panel_18, mesh=mesh_2)  # -> mesh, legend, title, colors, legend_par; plug-in component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
