# Grasshopper definition display_results.gh (Grasshopper 1.0.7)

# ---- group: Read info json
python = GhPythonScript(info_json="C:\baseline_test_2\info.json")  # -> out, a, vmt_facade_dst, vmt_rest_dst, context_dst, port, rad_mesh_files_list, rad_results_cummulative_list
# ---------- python: Python ----------
__author__ = "Pedersen_Admin"
__version__ = "2021.02.23"

import json

with open(info_json, 'r') as infile:
    json_data = json.load(infile)


vmt_facade_dst = json_data["vmt_facade_dst"]
vmt_rest_dst = json_data["vmt_rest_dst"]
context_dst = json_data["context_dst"]

rad_mesh_files_list = json_data["rad_mesh_files_list"]
rad_points_all = json_data["rad_points_all"]

rad_results_cummulative_list = json_data["rad_results_cummulative_list"]
# ---------- end python ----------

# ----
# Input geometry
importrad = Honeybee_ImportRad(radianceFile=python.vmt_facade_dst)  # -> RADMaterials, RADSurfaces; plug-in component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
importrad_2 = Honeybee_ImportRad(radianceFile=python.vmt_rest_dst)  # -> RADMaterials, RADSurfaces; plug-in component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
importrad_3 = Honeybee_ImportRad(radianceFile=python.context_dst)  # -> RADMaterials, RADSurfaces; plug-in component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
edges = BrepEdges(Brep=importrad_3.RADSurfaces)  # -> Naked, Interior, NonManifold
edges_2 = BrepEdges(Brep=[importrad.RADSurfaces, importrad_2.RADSurfaces])  # -> Naked, Interior, NonManifold
preview = CustomPreview(Geometry=[importrad.RADSurfaces, importrad_2.RADSurfaces], Material=ColourSwatch(SwatchColor=RGBA(255, 0, 42, 157)))
preview_2 = CustomPreview(Geometry=edges.Naked, Material=ColourSwatch(SwatchColor=RGB(0, 0, 0)))
preview_3 = CustomPreview(Geometry=importrad_3.RADSurfaces, Material=ColourSwatch(SwatchColor=RGBA(255, 255, 255, 226)))

# ---- group: Radiation mesh
# Radiation analysis
python_2 = GhPythonScript(rad_mesh_files_list=python.rad_mesh_files_list)  # -> out, rh_mesh, rh_centroids, rh_normals
# ---------- python_2: Python ----------
__author__ = "Pedersen_Admin"
__version__ = "2021.02.24"

import json
from ladybug_geometry.geometry3d.face import Mesh3D
from ladybug_rhino.fromgeometry import from_mesh3d, from_point3d

with open(rad_mesh_files_list, 'r') as infile:
    mesh_dict = json.load(infile)

lb_mesh = Mesh3D.from_dict(mesh_dict)
rh_mesh = from_mesh3d(lb_mesh)


lb_centroids = lb_mesh.face_centroids
lb_normals = lb_mesh.face_normals

rh_centroids = []
rh_normals = []
for i in range(len(lb_centroids)):
    rh_centroids.append(from_point3d(lb_centroids[i]))
    rh_normals.append(from_point3d(lb_normals[i]))
# ---------- end python_2 ----------
python_3 = GhPythonScript(rad_results_cummulative_list=python.rad_results_cummulative_list)  # -> output
# ---------- python_3: Python ----------
__author__ = "Pedersen_Admin"
__version__ = "2021.02.15"


with open(rad_results_cummulative_list, "r") as infile:
    content = infile.readlines()


output = []
for i in range(len(content)):
    output.append(float(content[i]))
# ---------- end python_3 ----------
graft = GraftTree(Tree=python_2.rh_mesh, IncludeEmptyLists=True, IncludeNullItems=True)

# ---- group: Legend parameters
cluster = Cluster(T=python_3)

# ---- group: Output legend
panel = Panel("""0
0
0""")
path = ConstructPath(Indices=panel)
path_2 = ConstructPath(Indices=panel)
branch = TreeBranch(Tree=python_3, Path=path_2, MaintainPaths=True)
branch_2 = TreeBranch(Tree=graft, Path=path, MaintainPaths=True)
heatmap = LBSpatialHeatmap(values=branch, mesh=branch_2, legend_par=cluster)  # -> mesh, legend, title, colors, legend_par; plug-in component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

# ---- group: Output radiation mesh
heatmap_2 = LBSpatialHeatmap(values=python_3, mesh=graft, legend_par=cluster)  # -> mesh, legend, title, colors, legend_par; plug-in component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
mesh = Mesh(heatmap_2.mesh)

# ---- group: Radiation points
vdis = VectorDisplay(Anchor=python_2.rh_centroids, Vector=python_2.rh_normals)

# ==== cluster Cluster
T = ClusterInput()
flatten = FlattenTree(Tree=T, Path="{0}")
sort = SortList(Keys=flatten)  # -> Keys, ValuesA
item = ListItem(List=sort.Keys, Index="-1", Wrap=True)
item_2 = ListItem(List=sort.Keys, Index="0", Wrap=True)
panel = Panel(item_2)
panel_2 = Panel(item)
legendpar = LBLegendParameters(min=item_2, max=item)  # -> leg_par; plug-in component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
leg_par = ClusterOutput(legendpar)
